# Grasshopper definition hairworm_basic_example.ghx (Grasshopper 0.9.64)
# plug-ins: Hairworm

panel = Panel("https://github.com/provolot/GrasshopperExchange/raw/master/Hairworm/_example_files/SphereMaker.ghcluster")
number_slider = Slider(33, range=0..100)
panel_2 = Panel("3")
# https://raw.github.com/provolot/GrasshopperExchange/master/Hairworm/_example_files/BoxSphereMakerVariableghx.ghx
number_slider_2 = Slider(8, range=0..10)
hairworm = Hairworm(ClusterURL=panel, Data=number_slider_2)  # -> Debug, Data
geo = Geometry()
